# Grasshopper definition random_walker_v001.gh (Grasshopper 1.0.7)

rectangle = Rectangle(Plane=PlaneXY(0, 0, 0), XSize=Slider(10, range=0..10), YSize=Slider(10, range=0..10), Radius=0)  # -> Rectangle, Length
boxrec = BoxRectangle(Rectangle=rectangle.Rectangle, Height=Slider(10, range=0..10))
wires = BrepWireframe(Brep=boxrec, Density=-1)
pop3d = Populate3D(Region=boxrec, Count=Slider(10, range=0..100), Seed=1)
pt = Point(simplify(graft(pop3d)))
